# Grasshopper definition 02_Cube_Approximation.gh (Grasshopper 0.9.76)
# plug-ins: Harmonics, Kangaroo Components, PlanktonGh

# ---- group: Initial mesh
# Cube approximation
rectangle = Rectangle(Plane=PlaneXY(0, 0, 0), XSize=Domain(-5, 5), YSize=Domain(-5, 5), Radius=0)  # -> Rectangle, Length
boundary = BoundarySurfaces(Edges=rectangle.Rectangle)
number_slider = Slider(10, range=0..100)
mesh_uv = MeshSurface(Surface=boundary, UCount=number_slider, VCount=number_slider, Overhang=True, Equalize=False)
start_pmesh = PlanktonMesh(mesh_uv)

# ---- group: Target surface
move = Move(Geometry=boundary, Motion=Vector(0, 0, 10))  # -> Geometry, Transform
cube = Surface(move.Geometry)

# ---- group: Set to true to calculate
toggle = BooleanToggle(False)

# ---- group: Create laplacian matrix and perform an eigendecomposition
pmesh = PlanktonMesh(start_pmesh)
nv = NakedVertices(Mesh=pmesh)  # -> ClothedIndex, NakedIndex, ClothedPts, NakedPts
graphlaplacian = GraphLaplacian(PlanktonMesh=pmesh)  # -> GraphLaplacian, K
bc = Boundary(LaplacianMatrix=graphlaplacian.GraphLaplacian, PlanktonMesh=pmesh, FixedPts=nv.NakedPts)  # -> ModifiedLaplacianMatrix, K
eigendecomp = EigenDecomposition(LaplacianMatrix=bc.ModifiedLaplacianMatrix, EigenCount=bc.K, RunCalculation=toggle)  # -> EigenValues, EigenVectors, EigenvectorMatrix

# ---- group: Back calculate mode ingredients
pmesh_2 = PlanktonMesh(start_pmesh)
all_eigenvectors = Matrix(eigendecomp.EigenvectorMatrix)
normals = PlanktonNormals(PlanktonMesh=pmesh_2)
srf = Surface(cube)
backcalcweights = BackCalcWeights(
    PMeshInitial=pmesh_2,
    TargetSurface=srf,
    VertexNormals=normals,
    EigenvectorMatrix=all_eigenvectors,
    EigsCount=Slider(10, range=0..100),
    Option=Slider(0, range=0..1),
    Rounding=Toggle(False),
    PresetSliders=Toggle(False))  # -> EigsIndices, BackCalculatedWeights, ScaleFactor, RootMeanSquare
extracteigs = ExtractEigenvectors(EigenVectorMatrix=all_eigenvectors, EigenvectorIndices=backcalcweights.EigsIndices)
eigenfunction = Eigenfunction(
    PMesh=pmesh_2,
    EigenvectorsMatrix=extracteigs,
    VertexNormals=normals,
    Weights=backcalcweights.BackCalculatedWeights,
    ScaleFactor=backcalcweights.ScaleFactor)  # -> SprayedRhinoMesh, PlanktonMesh

# ---- group: Display entire mode catalogue
all_eigenvectors_2 = Matrix(eigendecomp.EigenvectorMatrix)
pmesh_3 = PlanktonMesh(start_pmesh)
rhinodisplay = ModeDisplayRhino(
    PMesh=pmesh_3,
    Eigenvectors=all_eigenvectors_2,
    RowCount=Slider(10, range=0..100),
    IndexHighlight=Slider(0, range=0..100),
    ColourOption=Slider(0, range=0..1))  # -> Mesh, HighlightFrame
mesh = Mesh(rhinodisplay.Mesh)
preview = CustomPreview(Geometry=rhinodisplay.HighlightFrame, Shader=ColourSwatch(SwatchColor=RGB(0, 170, 255)))

# ----
cube_approximation_result = Mesh(eigenfunction.SprayedRhinoMesh)
