# Grasshopper definition 04_British_Museum_Great_Court_Roof.gh (Grasshopper 0.9.76)
# plug-ins: Harmonics, Squid, PlanktonGh, Kangaroo2 Components

# ---- group: Input
# British Museum Great Court Roof
initial_mesh = Mesh(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)
target_srf = Surface(<surface referenced from the Rhino model>)
pmesh = PlanktonMesh(initial_mesh)

# ---- group: Set to true to calculate
toggle = BooleanToggle(False)

# ---- group: Create laplacian matrix and perform an eigendecomposition
pmesh_2 = PlanktonMesh(pmesh)
nv = NakedVertices(Mesh=pmesh_2)  # -> ClothedIndex, NakedIndex, ClothedPts, NakedPts
graphlaplacian = GraphLaplacian(PlanktonMesh=pmesh_2)  # -> GraphLaplacian, K
bc = Boundary(LaplacianMatrix=graphlaplacian.GraphLaplacian, PlanktonMesh=pmesh_2, FixedPts=nv.NakedPts)  # -> ModifiedLaplacianMatrix, K
eigendecomp = EigenDecomposition(LaplacianMatrix=bc.ModifiedLaplacianMatrix, EigenCount=Slider(200, range=0..1000), RunCalculation=toggle)  # -> EigenValues, EigenVectors, EigenvectorMatrix

# ---- group: Display entire mode catalogue
all_eigenvectors = Matrix(eigendecomp.EigenvectorMatrix)
pmesh_3 = PlanktonMesh(pmesh)  # disabled
rhinodisplay = ModeDisplayRhino(
    PMesh=pmesh_3,
    Eigenvectors=all_eigenvectors,
    RowCount=Slider(10, range=0..100),
    IndexHighlight=Slider(0, range=0..100),
    ColourOption=Slider(0, range=0..1))  # -> Mesh, HighlightFrame
preview = CustomPreview(Geometry=rhinodisplay.HighlightFrame, Shader=ColourSwatch(SwatchColor=RGB(0, 170, 255)))
mesh = Mesh(rhinodisplay.Mesh)

# ----
pmesh_4 = PlanktonMesh(pmesh)

# ---- group: Set to true to preset slider values
toggle_2 = BooleanToggle(True)

# ----
all_eigenvectors_2 = Matrix(eigendecomp.EigenvectorMatrix)
normals = PlanktonNormals(PlanktonMesh=pmesh_4)
srf = Surface(target_srf)
backcalcweights = BackCalcWeights(
    PMeshInitial=pmesh_4,
    TargetSurface=srf,
    VertexNormals=normals,
    EigenvectorMatrix=all_eigenvectors_2,
    EigsCount=Slider(10, range=0..100),
    Option=Slider(0, range=0..1),
    Rounding=Toggle(False),
    PresetSliders=toggle_2)  # -> EigsIndices, BackCalculatedWeights, ScaleFactor, RootMeanSquare
extracteigs = ExtractEigenvectors(EigenVectorMatrix=all_eigenvectors_2, EigenvectorIndices=backcalcweights.EigsIndices)
significant_eigenvectors = Matrix(extracteigs)
scale = Panel(backcalcweights.ScaleFactor)
weights = Panel(backcalcweights.BackCalculatedWeights)
modedisplay = ModeDisplay(PMesh=pmesh_4, EigenvectorMatrix=significant_eigenvectors)  # -> Frame, FacesAsCurves, FillColours
eigenvector_indices = Panel(backcalcweights.EigsIndices)
rms = Panel(backcalcweights.RootMeanSquare)
preview_2 = SquidPreview(rec=modedisplay.Frame, crv=modedisplay.FacesAsCurves, fill=modedisplay.FillColours)  # -> mode0, mode1, mode2, mode3, mode4, mode5, mode6, mode7, mode8, mode9
qpreview = QuickPreview(Bitmap=preview_2.mode5)
qpreview_2 = QuickPreview(Bitmap=preview_2.mode0)
w0 = Slider(1, range=-1..1)
w5 = Slider(0.031, range=-1..1)
scale_2 = Slider(140.383, range=0..200)
qpreview_3 = QuickPreview(Bitmap=preview_2.mode6)
qpreview_4 = QuickPreview(Bitmap=preview_2.mode1)
w6 = Slider(0.03, range=-1..1)
w1 = Slider(-0.091, range=-1..1)
qpreview_5 = QuickPreview(Bitmap=preview_2.mode7)
qpreview_6 = QuickPreview(Bitmap=preview_2.mode2)
w2 = Slider(-0.087, range=-1..1)
w7 = Slider(0.024, range=-1..1)
qpreview_7 = QuickPreview(Bitmap=preview_2.mode8)
qpreview_8 = QuickPreview(Bitmap=preview_2.mode3)
w8 = Slider(0.018, range=-1..1)
w3 = Slider(-0.033, range=-1..1)
qpreview_9 = QuickPreview(Bitmap=preview_2.mode9)
qpreview_10 = QuickPreview(Bitmap=preview_2.mode4)
w4 = Slider(-0.032, range=-1..1)
w9 = Slider(0.016, range=-1..1)
merge = Merge(Data1=w0, Data2=w1, Data3=w2, Data4=w3, Data5=w4, Data6=w5, Data7=w6, Data8=w7, Data9=w8, Data10=w9)
scale_3 = Number(scale_2)
w = Number(merge)
eigenfunction = Eigenfunction(PMesh=pmesh_4, EigenvectorsMatrix=significant_eigenvectors, VertexNormals=normals, Weights=w, ScaleFactor=scale_3)  # -> SprayedRhinoMesh, PlanktonMesh
approximation_result = Mesh(eigenfunction.SprayedRhinoMesh)

# ==== cluster SquidPreview: Creates Squid bitmaps to visualise 10 modes on the canvas via the "Squid Preview" component
rec = ClusterInput()
crv = ClusterInput()
fill = ClusterInput()
draw = Draw(Curve=crv, Accuracy=-1, Fill=fill)  # -> simplify(SquidInstr), Curve
bang = ExplodeTree(Data=draw.SquidInstr)  # -> Branch0, Branch1, Branch2, Branch3, Branch4, Branch5, Branch6, Branch7, Branch8, Branch9
squid = Squid(BitmapR=rec, SquidInstr=bang.Branch0, PPU=1, AA=True, autohide=False)
squid_2 = Squid(BitmapR=rec, SquidInstr=bang.Branch1, PPU=1, AA=True, autohide=False)
squid_3 = Squid(BitmapR=rec, SquidInstr=bang.Branch2, PPU=1, AA=True, autohide=False)
squid_4 = Squid(BitmapR=rec, SquidInstr=bang.Branch3, PPU=1, AA=True, autohide=False)
squid_5 = Squid(BitmapR=rec, SquidInstr=bang.Branch4, PPU=1, AA=True, autohide=False)
squid_6 = Squid(BitmapR=rec, SquidInstr=bang.Branch5, PPU=1, AA=True, autohide=False)
squid_7 = Squid(BitmapR=rec, SquidInstr=bang.Branch6, PPU=1, AA=True, autohide=False)
squid_8 = Squid(BitmapR=rec, SquidInstr=bang.Branch7, PPU=1, AA=True, autohide=False)
squid_9 = Squid(BitmapR=rec, SquidInstr=bang.Branch8, PPU=1, AA=True, autohide=False)
squid_10 = Squid(BitmapR=rec, SquidInstr=bang.Branch9, PPU=1, AA=True, autohide=False)
mode0 = ClusterOutput(squid)
mode1 = ClusterOutput(squid_2)
mode2 = ClusterOutput(squid_3)
mode3 = ClusterOutput(squid_4)
mode4 = ClusterOutput(squid_5)
mode5 = ClusterOutput(squid_6)
mode6 = ClusterOutput(squid_7)
mode7 = ClusterOutput(squid_8)
mode8 = ClusterOutput(squid_9)
mode9 = ClusterOutput(squid_10)
